# Grasshopper definition new face, road test.gh (Grasshopper 1.0.7)
# plug-ins: Urbano, RhinoCodePluginGH, MeshEdit Components, Human, Pufferfish, Centipede, LunchBox, Heteroptera

# ---- group: Download OSM
# Toggle "Run" button
panel = Panel("-73.985")
download_openstreetmap_osm = DownloadOpenStreetMapOSM(LeftBound=panel, RightBound="-73.98", TopBound="40.725", BottomBound="40.72", RunToggle=False)  # -> OSMQueryURL, OSMFilePath

# ----
template = ImportUrbanoTemplate()

# ---- group: tabriz osm into grasshopper
path = FilePath("D:\IAAC\gh\final 2\map (1).osm")
path_2 = FilePath("D:\IAAC\gh\final 2\map (1).osm")

# ---- group: importing / extracting data
osmstreetnet = ImportOSMStreetNetwork(OSMPathOrURL=path_2)  # -> StreetNetwork, StreetSegmentCurves, UTMZone, TranslationVector
import_osm_features = ImportOSMFeatures(OSMPathOrURL=path_2, OSMFeatureType="amenity", Format="xml", ImportAltitude=False)  # -> Points, Metadata, UTMZone, TranslationVector
# Total Area Occupied
import_osm_features_2 = ImportOSMFeatures(OSMPathOrURL=path_2, OSMFeatureType="street", Format="xml", ImportAltitude=False)  # -> Points, Metadata, UTMZone, TranslationVector
import_osm_features_3 = ImportOSMFeatures(OSMPathOrURL=path_2, OSMFeatureType="building", Format="xml", ImportAltitude=False)  # -> Points, Metadata, UTMZone, TranslationVector

# ---- group: aminities data understanding and its visualisation
data = Data([Point(4584.34, 3691.97, 0), Point(196.1, 3877.12, 0), Point(2540.49, 693.92, 0), Point(1098.85, 977.06, 0), Point(4311.29, 111.82, 0), Point(3956.36, 1047.9, 0)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])
Z = UnitZ(Factor=Slider(800, range=0..1000))
pt = Point(flatten(import_osm_features.Points))
move = Move(Geometry=data, Motion=Z)  # -> Geometry, Transform
lng = ListLength(List=pt)
ln = Line(StartPoint=data, EndPoint=move.Geometry)
pipe = Pipe(Curve=ln, Radius=Slider(9, range=0..10), Caps=0)
preview = CustomPreview(Geometry=pipe, Material=ColourSwatch(SwatchColor=RGB(86, 255, 255)))

# ----
meta = Metadata(import_osm_features.Metadata)

# ---- group: building data understanding
pline = PolyLine(Vertices=import_osm_features_3.Points, Closed=False)
meta_2 = Metadata(import_osm_features_3.Metadata)
create_building = CreateBuilding(BuildingCurve=pline, Metadata=meta_2)
lookup_metadata = LookupMetadata(MetadataGeometry=create_building, SearchKey="height")
panel_2 = Panel(lookup_metadata)

# ---- group: e.g. Filter Street Types
lookup_metadata_2 = LookupMetadata(MetadataGeometry=import_osm_features_2.Metadata, SearchKey="highway")
list = ValueList({"footway", "primary", "secondary", "residential", "motorway", "trunk", "tertiary", "unclassified", "service", "motorway_link", "trunk_link", "primary_link", "secondary_link", "motorway_junction", "yes", "road", "living street", "pedestrian", "path", "bridleway", "cycleway", "raceway", "steps"}, selected="primary")
pline_2 = PolyLine(Vertices=import_osm_features_2.Points, Closed=False)
tmatch = MatchText(Text=flatten(lookup_metadata_2), Pattern=graft(list), Case=True)
dispatch = Dispatch(List=flatten(pline_2), DispatchPattern=tmatch)  # -> ListA, ListB
crv = Curve(dispatch.ListA)

# ----
list_2 = ValueList({"footway", "primary", "secondary", "residential", "motorway", "trunk", "tertiary", "unclassified", "service", "motorway_link", "trunk_link", "primary_link", "secondary_link", "motorway_junction", "yes", "road", "living street", "pedestrian", "path", "bridleway", "cycleway", "raceway", "steps"}, selected="secondary")
lookup_metadata_3 = LookupMetadata(MetadataGeometry=import_osm_features.Metadata, SearchKey="amenity")
pline_3 = PolyLine(Vertices=import_osm_features_2.Points, Closed=False)
deconstruct_metadata = DeconstructMetadata(Metadata=meta)  # -> Keys, Values

# ---- group: deviding aminities into commercial and non commercial
panel_3 = Panel(lookup_metadata_3)
cset = CreateSet(List=flatten(panel_3))  # -> Set, Map
nullrep = ReplaceNulls(Items=panel_3, Replacements="Restaurant")  # -> flatten(Items), Count
panel_4 = Panel(cset.Set)
commercial = Panel("""restaurant
mall_store
convenience_store
bank
clinic
it
toilets
company
copyshop_store
pastry_store
shop
bakery_store
department_store_store
doctors
computer_store
hairdresser_supply_store
travel_agency_store
pharmacy""")
non_commercial = Panel("""telecommunication
police
library
college
educational_institution
place_of_worship
vehicle_inspection
financial
diplomatic
social_facility
fire_station
research""")
py3 = Python3Script(x=nullrep.Items, com=commercial, noncom=non_commercial)  # -> out, a; inputs x: list, com: list, noncom: list
# ---------- py3: Python ----------
a = []
for i in range(len(x)):
    if(x[i] in com):
        a.append("Commercial")
    else:
        a.append("nonCommercial")
# ---------- end py3 ----------

# ----
tmatch_2 = MatchText(Text=flatten(lookup_metadata_2), Pattern=graft(list_2), Case=True)
panel_5 = Panel(deconstruct_metadata.Values)
panel_6 = Panel(deconstruct_metadata.Keys)
dispatch_2 = Dispatch(List=flatten(pline_3), DispatchPattern=tmatch_2)  # -> ListA, ListB

# ---- group: Merge amenity capacity to metadata
amenity_capacity = AmenityCapacity(
    Activity=panel_3,
    Area=-1,
    LogisticsAreaProportion=0.2,
    AmenityCapacityData="""post_office, 5, 15
bank, 5, 15
cinema, 1, 248
theatre, 1, 215
arts_centre, 3, 20
department_store, 1, 78
supermarket_store, 2, 32
convenience_store, 1, 39
hardware_store, 1, 50
pharmacy, 1, 42
restaurant, 2, 35
fast_food, 1, 36
cafe, 1, 50
bar, 1, 47
pub, 1, 47
clothes_store, 2, 21
books_store, 1, 26
beauty_store, 1, 27
shoes_store, 1, 38""")
merge_metadata = MergeMetadata(Metadata=meta, Metadata_2=amenity_capacity)
lookup_metadata_4 = LookupMetadata(MetadataGeometry=merge_metadata, SearchKey="amenity_capacity")
panel_7 = Panel(lookup_metadata_4)

# ---- group: existing data of house, road visualising
pline_4 = PolyLine(Vertices=import_osm_features_2.Points, Closed=False)  # -> flatten(Polyline)
Z_2 = UnitZ(Factor=Slider(500, range=0..1000))
pt_2 = Point(flatten(import_osm_features_3.Points))
move_2 = Move(Geometry=pt_2, Motion=Z_2)  # -> Geometry, Transform
lng_2 = ListLength(List=pt_2)
ln_2 = Line(StartPoint=pt_2, EndPoint=move_2.Geometry)
pipe_2 = Pipe(Curve=flatten(pline_4), Radius=Slider(4, range=0..10), Caps=0)
pipe_3 = Pipe(Curve=ln_2, Radius=Slider(7, range=0..10), Caps=0)
preview_2 = CustomPreview(Geometry=pipe_3, Material=ColourSwatch(SwatchColor=RGB(55, 155, 222)))
preview_3 = CustomPreview(Geometry=pipe_2, Material=ColourSwatch(SwatchColor=RGB(0, 0, 255)))

# ----
avr = Average(Input=import_osm_features_3.Points)  # -> flatten(ArithmeticMean)
lng_3 = ListLength(List=avr)
repeat = RepeatData(Data="Residential", Length=lng_3)

# ----
# GRIDING (based on bounding of the city i extracted)
number_slider = Slider(50, range=0..100)
bbox = BoundingBox(Content=flatten(osmstreetnet.StreetSegmentCurves), Plane=PlaneXY(0, 0, 0), UnionBox=True)  # -> Box, Box_2
rec = Rectangle(bbox.Box)
avr_2 = Average(Input=import_osm_features.Points)  # -> flatten(ArithmeticMean)
mesh_uv = MeshSurface(Surface=rec, UCount=number_slider, VCount=number_slider, Overhang=True, Equalize=False)
faceb = FaceBoundaries(Mesh=mesh_uv)
preview_4 = CustomPreview(Geometry=mesh_uv, Material=ColourSwatch(SwatchColor=RGB(255, 71, 255)))

lng_4 = ListLength(List=faceb)
repeat_2 = RepeatData(Data="0", Length=lng_4)  # -> simplify(graft(Data))
concat = Concatenate(FragmentA="avrage aminities per cell", JoinSeparator=" : ")

incurves = PointInCurves(Point=avr_2, Curves=faceb)  # -> Relationship, Index, Point
# relating points
# (data 1.aminities(devided) 2.residential)
# to the grids
python = GhPythonScript(x=py3.a, y=incurves.Index)  # -> out, a; inputs x: list, y: list of Int32
# ---------- python: Python ----------
from Grasshopper.Kernel.Data import GH_Path
from Grasshopper import DataTree
a = DataTree[object]()
path = []
for i in range(len(x)):

    a.Add(x[i], GH_Path(y[i]))
# ---------- end python ----------
python_2 = GhPythonScript(x=repeat, y=incurves.Index)  # -> out, a; inputs x: list, y: list of Int32; same code as python

data_2 = Data(python.a)
merge = Merge(Data1=repeat_2, Data2=data_2)
num = Number(merge)
cluster = Cluster(L=lng_4)
lng_5 = ListLength(List=python_2.a)
equals = Equality(FirstNumber=num, SecondNumber="0")  # -> Equality, Inequality
pt_3 = ConstructPoint(XCoordinate=Slider(37, range=0..1000), YCoordinate=Slider(226, range=0..1000), ZCoordinate=0)
merge_2 = Merge(Data1=cluster, Data2=lng_5)
cull = CullPattern(List=merge, CullPattern=invert(equals.Equality))
cluster_2 = Cluster_2(L=lng_4)
texttoscreen = RenderTextToScreen(Text=concat, Location=pt_3, Size=12, Color=RGB(0, 0, 0), m_scWithvp=False)
merge_3 = Merge(Data1=cull, Data2=data_2)

# ----
# creating sorted layers of visualisation for existing aminities data based on data cleaning and spliting done befor
# 
# the outcome is used for defining the text visualising too
panel_8 = Panel("nonCommercial")
replace = ReplaceMembers(Set=merge_3, Find=[panel_8, "Commercial"], Replace=["0", "1"])
item = ListItem(
    List=[ColourSwatch(SwatchColor=RGB(25, 176, 176)), ColourSwatch(SwatchColor=RGB(164, 255, 137))],
    Index=replace,
    Wrap=True)
lng_6 = ListLength(List=item)
equals_2 = Equality(FirstNumber=flatten(replace), SecondNumber="1")  # -> Equality, Inequality
series = Series(Start=0, Step=Slider(115, range=0..1000), Count=lng_6)
int = Integer(equals_2.Inequality)
int_2 = Integer(equals_2.Equality)
ma = MassAddition(Input=int)  # -> Result, PartialResults
ma_2 = MassAddition(Input=int_2)  # -> Result, PartialResults

# ---- group: TEXT
roundd = RoundToDecimalPlace(NumberX=lng_2, DecimalPlace="2", RoundType=0)  # -> Rounded, Difference
roundd_2 = RoundToDecimalPlace(NumberX=lng, DecimalPlace="2", RoundType=0)  # -> Rounded, Difference
concat_2 = Concatenate(FragmentA="General aminitie count(Commercial, Non-commercial etc.)", FragmentB=roundd.Rounded, JoinSeparator=" : ")
concat_3 = Concatenate(FragmentA="Residential count", FragmentB=roundd_2.Rounded, JoinSeparator=" : ")
pt_4 = ConstructPoint(XCoordinate=Slider(37, range=0..1000), YCoordinate=Slider(82, range=0..1000), ZCoordinate=0)
pt_5 = ConstructPoint(XCoordinate=Slider(37, range=0..1000), YCoordinate=Slider(113, range=0..1000), ZCoordinate=0)
texttoscreen_2 = RenderTextToScreen(Text=concat_2, Location=pt_4, Size=12, Color=RGB(0, 0, 0), m_scWithvp=False)
texttoscreen_3 = RenderTextToScreen(Text=concat_3, Location=pt_5, Size=12, Color=RGB(0, 0, 0), m_scWithvp=False)
roundd_3 = RoundToDecimalPlace(NumberX=lng_4, DecimalPlace="2", RoundType=0)  # -> Rounded, Difference
roundd_4 = RoundToDecimalPlace(NumberX=ma.Result, DecimalPlace="2", RoundType=0)  # -> Rounded, Difference
roundd_5 = RoundToDecimalPlace(NumberX=ma_2.Result, DecimalPlace="2", RoundType=0)  # -> Rounded, Difference
concat_4 = Concatenate(FragmentA="cell numbers", FragmentB=roundd_3.Rounded, JoinSeparator=" : ")
concat_5 = Concatenate(FragmentA="non-commercial", FragmentB=roundd_4.Rounded, JoinSeparator=" : ")
concat_6 = Concatenate(FragmentA="commercial", FragmentB=roundd_5.Rounded, JoinSeparator=" : ")
number_slider_2 = Slider(5, range=0..1000)
pt_6 = ConstructPoint(XCoordinate=number_slider_2, YCoordinate=Slider(141, range=0..1000), ZCoordinate=0)
pt_7 = ConstructPoint(XCoordinate=Slider(37, range=0..1000), YCoordinate=Slider(172, range=0..1000), ZCoordinate=0)
pt_8 = ConstructPoint(XCoordinate=Slider(37, range=0..1000), YCoordinate=Slider(197, range=0..1000), ZCoordinate=0)
texttoscreen_4 = RenderTextToScreen(Text=concat_4, Location=pt_6, Size=12, Color=RGB(0, 0, 0), m_scWithvp=False)
texttoscreen_5 = RenderTextToScreen(Text=concat_5, Location=pt_7, Size=12, Color=RGB(0, 0, 0), m_scWithvp=False)
texttoscreen_6 = RenderTextToScreen(Text=concat_6, Location=pt_8, Size=12, Color=RGB(0, 0, 0), m_scWithvp=False)

# ----
residential = Panel(merge_2)
cset_2 = CreateSet(List=merge_3)  # -> Set, Map
merge_4 = Merge(Data1=cluster_2, Data2=merge_2)
smesh = SimpleMesh(Brep=faceb)  # -> graft(Mesh)
panel_9 = Panel(cset_2.Map)
sort = SortList(Keys=merge_4)  # -> reverse(Keys), ValuesA
item_2 = ListItem(List=sort.Keys, Index=0, Wrap=True)
Z_3 = UnitZ(Factor=series)
move_3 = Move(Geometry=simplify(graft(smesh)), Motion=simplify(Z_3))  # -> Geometry, Transform
equals_3 = Equality(FirstNumber=panel_9, SecondNumber="1")  # -> Equality, Inequality
equals_4 = Equality(FirstNumber=panel_9, SecondNumber="0")  # -> Equality, Inequality
panel_10 = Panel(equals_3.Equality)
preview_5 = CustomPreview(Geometry=move_3.Geometry, Material=item)
int_3 = Integer(equals_4.Equality)
int_4 = Integer(panel_10)
ma_3 = MassAddition(Input=int_3)  # -> Result, PartialResults
ma_4 = MassAddition(Input=int_4)  # -> Result, PartialResults

# ----
# visualising and mapping avrage aminities per each cell into pipes
bnd = Bounds(Numbers=flatten(item_2))
dom = ConstructDomain(DomainStart=Slider(10, range=0..10), DomainEnd=Slider(4348, range=0..100000))
remap = RemapNumbers(Value=flatten(item_2), Source=bnd, Target=dom)  # -> Mapped, Clipped
cir = Circle(Plane=avr_2, Radius="20")
Z_4 = UnitZ(Factor=remap.Mapped)
extr = Extrude(Base=cir, Direction=flatten(Z_4))
preview_6 = CustomPreview(Geometry=extr, Material=ColourSwatch(SwatchColor=RGB(255, 255, 63)))

nullrep_2 = ReplaceNulls(Items=ma_3.Result, Replacements="0")  # -> Items, Count
# extracted, cleaned avrage data existance per cells
# (our data is modified based on cell numbers)
nullrep_3 = ReplaceNulls(Items=ma_4.Result, Replacements="0")  # -> Items, Count

non_commercial_2 = Panel(nullrep_3.Items)
commercial_2 = Panel(nullrep_2.Items)
residential_2 = Panel(item_2)

int_5 = Integer(residential_2)

# ----
# very late but very hard tried attempt
# for writting second rule of the growth based on residential avrage point and their distance between first and second degree roads
panel_11 = Panel(crv)
crv_2 = Curve(dispatch_2.ListA)
panel_12 = Panel(crv_2)
py3_2 = Python3Script(
    cells=faceb,
    iterations=Slider(488, range=0..1000),
    residential_areas=flatten(int_5),
    primary_roads=panel_11,
    secondary_roads=panel_12)  # -> out, flatten(residential_areas); inputs cells: list of Polyline, iterations: Int32, residential_areas: list of Int32; disabled
# ---------- py3_2: Python ----------
import Rhino.Geometry as rg

def cellular_automata(residential_areas, primary_roads, secondary_roads, iterations):
    """
    Perform cellular automaton based on road variation affecting residential areas, considering the count of points in each cell.

    Args:
    residential_areas (Dict[Point3d, int]): Initial state of residential areas with the count of points in each cell.
    primary_roads (List[Curve]): List of primary road curves.
    secondary_roads (List[Curve]): List of secondary road curves.
    iterations (int): Number of iterations for the cellular automaton.

    Returns:
    Dict[Point3d, int]: Final state of residential areas after iterations with the count of points in each cell.
    """
    # Define the influence range for roads
    primary_influence = 30  # Influence range for primary roads
    secondary_influence = 20  # Influence range for secondary roads

    for iteration in range(iterations):
        new_areas = residential_areas.copy()

        for cell, count in residential_areas.items():
            # Initialize minimum distances to a large value
            min_primary_dist = float('inf')
            min_secondary_dist = float('inf')

            # Find the closest primary and secondary road and their distances
            for primary_road in primary_roads:
                temp_dist = primary_road.PointAtClosestApproach(cell, False).DistanceTo(cell)
                if temp_dist < min_primary_dist:
                    min_primary_dist = temp_dist

            for secondary_road in secondary_roads:
                temp_dist = secondary_road.PointAtClosestApproach(cell, False).DistanceTo(cell)
                if temp_dist < min_secondary_dist:
                    min_secondary_dist = temp_dist

            # Update cell based on proximity to roads and existing population
            if min_primary_dist <= primary_influence or min_secondary_dist <= secondary_influence:
                new_areas[cell] = count + 1  # Increase the count to indicate development

        # Update the areas for the next iteration
        residential_areas = new_areas

    return residential_areas  # Final state with updated counts

# Grasshopper inputs and outputs setup as before
# ---------- end py3_2 ----------
explode = MeshExplode(Mesh=mesh_uv, Interpolate=False)
panel_13 = Panel("""Residential
Undevloped""")
replace_2 = ReplaceMembers(
    Set=flatten(py3_2.residential_areas),
    Find=panel_13,
    Replace=[ColourSwatch(SwatchColor=RGB(230, 200, 200)), ColourSwatch(SwatchColor=RGB(227, 113, 113))])
unim = UnifyMesh(Mesh=explode)  # -> Result, Count
preview_7 = CustomPreview(Geometry=unim.Result, Material=replace_2)

int_6 = Integer(non_commercial_2)
int_7 = Integer(commercial_2)

# ---- group: celullar code
# iteration based on commercial, non-commercial
#  effecting residential growth (aggrigation) or population
number_slider_3 = Slider(50, range=0..50)
py3_3 = Python3Script(
    cells=faceb,
    iterations=number_slider_3,
    residential_counts=flatten(int_5),
    commercial_counts=flatten(int_7),
    non_commercial_counts=flatten(int_6))  # -> out, a; inputs cells: list of Polyline, iterations: Int32, residential_counts: list of Int32, commercial_counts: list of Int32, non_commercial_counts: list of Int32
# ---------- py3_3: Python ----------
import random

def apply_rules(residential, commercial):
    """
    Determine the state of a cell with a focus on converting undeveloped cells into residential or commercial areas,
    based on the counts of surrounding residential and commercial entities. This version of the rules aims to
    simulate more aggressive development, especially in areas with any residential or commercial presence.
    """
    # Increase the chance of development in undeveloped areas
    random_factor = random.random()  # Generates a random float number between 0.0 to 1.0
    
    if residential > 0 or commercial > 0:
        # Aggressively promote development if there's any nearby residential or commercial presence
        if commercial > residential:
            if random_factor < 0.5:  # 50% chance for commercial development if commercial entities are more prominent
                return 'Commercial'
            else:
                return 'Residential'
        else:
            if random_factor < 0.7:  # 70% chance for residential development if residential entities are equal or more
                return 'Residential'
            else:
                return 'Commercial'
    elif random_factor < 0.2:  # Even with no adjacent development, 20% chance to become residential
        return 'Residential'
    else:
        # Remain undeveloped if none of the above conditions are met, with a lower chance to ensure more development
        return 'Undeveloped'

def simulate_growth(residential_counts, commercial_counts, iterations):
    """
    Simulate urban growth over a specified number of iterations, with revised rules to aggressively promote the
    development of undeveloped cells into residential or commercial areas.
    """
    states = ['Undeveloped'] * len(residential_counts)  # Initialize all cells as 'Undeveloped'
    for _ in range(iterations):
        new_states = []
        for idx in range(len(states)):
            new_state = apply_rules(residential_counts[idx], commercial_counts[idx])
            new_states.append(new_state)
        states = new_states
    return states

# Assuming the lists for residential_counts and commercial_counts are defined elsewhere
iterations = 300  # Adjust the number of iterations as needed for more extended simulation

# Execute the simulation
a = simulate_growth(residential_counts, commercial_counts, iterations)
# ---------- end py3_3 ----------

# ----
panel_14 = Panel(py3_3.a)

# ---- group: Animation
number_slider_4 = Slider(0, range=0..100)
number_slider_5 = Slider(0, range=0..100)
centi = Centipede(
    startv=number_slider_5,
    endv=Slider(1, range=0..1),
    fstart=number_slider_5,
    fend=Slider(100, range=0..100),
    fprogress=number_slider_4)
division = Division(A=number_slider_4, B=Slider(10, range=0..10))
round = Round(Number=division)  # -> Nearest, Floor, Ceiling

# ---- group: visualising outcome of the code
data_3 = Data(["Undeveloped", "Commercial", "Residential"])
panel_15 = Panel(data_3)
swatch = ColourSwatch(SwatchColor=RGB(227, 113, 113))
swatch_2 = ColourSwatch(SwatchColor=RGB(100, 175, 69))
swatch_3 = ColourSwatch(SwatchColor=RGB(55, 155, 222))
replace_3 = ReplaceMembers(Set=py3_3.a, Find=panel_15, Replace=[Slider(381, range=0..1000), Slider(748, range=0..1000), Slider(330, range=0..1000)])
explode_2 = MeshExplode(Mesh=mesh_uv, Interpolate=False)

# ----
replace_4 = ReplaceMembers(Set=py3_3.a, Find=panel_15, Replace=[swatch, swatch_2, swatch_3])
center = Center(Geometry=explode_2)  # -> Center, Dimension
scale = Scale(Geometry=explode_2, Center=center.Center, Factor=Slider(0.85, range=0..1))  # -> Geometry, Transform
Z_5 = UnitZ(Factor=replace_3)

pt_9 = Point(replace_3)
Z_6 = UnitZ(Factor=Slider(6090, range=0..10000))
Z_7 = UnitZ(Factor=Slider(3302, range=0..10000))
move_4 = Move(Geometry=pt_9, Motion=Z_6)  # -> Geometry, Transform
move_5 = Move(Geometry=pt_9, Motion=Z_7)  # -> Geometry, Transform
ln_3 = Line(StartPoint=move_5.Geometry, EndPoint=move_4.Geometry)
end = EndPoints(Curve=ln_3)  # -> Start, End
Y = UnitY(Factor=Slider(570, range=0..10000))
move_6 = Move(Geometry=end.End, Motion=Y)  # -> Geometry, Transform
ln_4 = Line(StartPoint=end.End, EndPoint=move_6.Geometry)
pdecon = Deconstruct(Point=move_6.Geometry)  # -> XComponent, YComponent, ZComponent
merge_5 = Merge(Data1=ln_3, Data2=ln_4)

# ---- group: final text, list dash
panel_16 = Panel("""COMMERCIAL
UNDEVELOPED
RESIDENTIAL""")
dash = DashPattern(Curve=merge_5, Pattern="5")  # -> Dashes, Gaps
pt_10 = ConstructPoint(
    XCoordinate=number_slider_2,
    YCoordinate=[Slider(128, range=0..1000), Slider(109, range=0..1000), Slider(149, range=0..1000)],
    ZCoordinate=0)
previewlw = CustomPreviewLineweights(Geometry=dash.Dashes, Shader=ColourSwatch(SwatchColor=RGB(0, 0, 0)), Thickness=Slider(0.1, range=0..10), Absolute=True)
texttoscreen_7 = RenderTextToScreen(
    Text=panel_16,
    Location=pt_10,
    Size=Slider(14, range=0..100),
    Color=[ColourSwatch(SwatchColor=RGB(80, 192, 69)), ColourSwatch(SwatchColor=RGB(227, 113, 113)), ColourSwatch(SwatchColor=RGB(55, 155, 222))],
    m_scWithvp=False)

# ----
tstat = TreeStatistics(Tree=explode_2)  # -> Paths, Length, Count
item_3 = ListItem(List=tstat.Paths, Index=round.Floor, Wrap=True)
branch = TreeBranch(Tree=explode_2, Path=item_3, MaintainPaths=True)
panel_17 = Panel(centi)
number_slider_6 = Slider(0.9, range=0..1)
dedom2 = DeconstructDomain²(Domain=branch)  # -> UComponent, VComponent
dom_2 = ConstructDomain(DomainStart=0, DomainEnd=centi)
panel_18 = Panel(dedom2.UComponent)
dom² = ConstructDomain²(DomainU=dom_2, DomainV=dedom2.VComponent)

# ---- group: visualising outcome of the code (continued)
unim_2 = UnifyMesh(Mesh=scale.Geometry)  # -> Result, Count

# ----
mshextrude = MeshExtrude(Mesh=unim_2.Result, Direction=Z_5, SolidToggle=True, ExtrudeBothSidesToggle=False)

# ---- group: visualising outcome of the code (continued)
preview_8 = CustomPreview(Geometry=mshextrude, Material=replace_4)

# ==== cluster Cluster
L = ClusterInput()
repeat = RepeatData(Data="0", Length=L)  # -> simplify(graft(Data))
num = Number(repeat)
equals = Equality(FirstNumber=num, SecondNumber="0")  # -> Equality, Inequality
cull = CullPattern(List=repeat, CullPattern=invert(equals.Equality))
L_2 = ClusterOutput(cull)

# ==== cluster Cluster_2
L = ClusterInput()
repeat = RepeatData(Data="0", Length=L)  # -> simplify(graft(Data))
num = Number(repeat)
equals = Equality(FirstNumber=num, SecondNumber="0")  # -> Equality, Inequality
cull = CullPattern(List=repeat, CullPattern=invert(equals.Equality))
D = ClusterOutput(repeat)
